test file "TestCase3"

suite "New Test Suite 1"

  case "testCaseCPS_PowerSync_System" [baseline]
    model CPS_PowerSync_System
    assessment "S_EV_#1": At any point of time, (~(plug==false)) | (pReq==false) must be true
    assessment "S_EV_#2": At any point of time, (~(SoC==1)) | (pReq==false) must be true
    assessment "S_CP_#1": At any point of time, ((~(enablePowerFlow==true)) | (plug==true)) must be true
    assessment "S_CP_#2": At any point of time, (~(errorState==true) | (enablePowerFlow==false)) must be true
    assessment "S_EV&CP_#1": At any point of time, (~(enablePowerFlow==true)) | (SoC~=1) must be true
    assessment "S_CPS_#1": At any point of time, pFlow_1 + pFlow_2 + pFlow_3 must be greater than or equal to 0 and less than or equal to generatorPower
    assessment "S_CPS_#2": At any point of time, pS_1_idle + pS_2_idle + pS_3_idle == 0 must be true
    assessment "S_CPS_#3": At any point of time, if (pReq_1_a ~= pReq_1_p) | ((pReq_2_a ~= pReq_2_p) | (pReq_3_a ~= pReq_3_p)) becomes true then, with a delay of at most 4, ((pFlow_1 == alfa) & (pFlow_2 == beta) & (pFlow_3 == gamma)) | ((pReq_1_a ~= pReq_1_p) | ((pReq_2_a ~= pReq_2_p) | (pReq_3_a ~= pReq_3_p))) must be true
    assessment "S_EV_#3": At any point of time, if completedState==  true becomes true then, with a delay of at most 0.1, pReq == false must stay true until SoC<=0.95 | plug==false becomes true (within 0.1)
      plug: signal CPS_PowerSync_System/ElecritcVehicles1, port 2
      pReq: signal CPS_PowerSync_System/ElecritcVehicles1, port 1
      SoC: signal CPS_PowerSync_System/MATLAB Function, port 1
      enablePowerFlow: signal CPS_PowerSync_System/ChargingPoint1, port 1
      errorState: signal CPS_PowerSync_System/ChargingPoint1, port 2
      generatorPower: signal CPS_PowerSync_System/Cast To Double7, port 1
      pFlow_1: signal CPS_PowerSync_System/Switch, port 1
      pFlow_2: signal CPS_PowerSync_System/Switch1, port 1
      pFlow_3: signal CPS_PowerSync_System/Switch2, port 1
      pS_1_idle: signal CPS_PowerSync_System/Subsystem5/Product3, port 1
      pS_2_idle: signal CPS_PowerSync_System/Subsystem4/Product4, port 1
      pS_3_idle: signal CPS_PowerSync_System/Subsystem3/Product5, port 1
      pReq_1_a: signal CPS_PowerSync_System/ElecritcVehicles1, port 1
      pReq_1_p: signal CPS_PowerSync_System/Delay1, port 1
      pReq_2_a: signal CPS_PowerSync_System/ElecritcVehicles2, port 1
      pReq_2_p: signal CPS_PowerSync_System/Delay2, port 1
      pReq_3_a: signal CPS_PowerSync_System/ElecritcVehicles3, port 1
      pReq_3_p: signal CPS_PowerSync_System/Delay6, port 1
      alfa: signal CPS_PowerSync_System/Product4, port 1
      beta: signal CPS_PowerSync_System/Product5, port 1
      gamma: signal CPS_PowerSync_System/Product6, port 1
      completedState: signal CPS_PowerSync_System/ElecritcVehicles1, port 3